vi "Main.gviweb"   [LabVIEW NXG 2.0.0]
panel controls:
  "Slider": f64
panel indicators:
  "Observed Data and Fitted Curve": cluster{"Element 1": f64, "Element 2": f64}[][]
  "Pass/Fail": bool
  "Data Grid": T1[]
  "Gauge": f64
types:
  T1 = cluster{"Step Name": string, "Description": f64, "Pass/Fail": bool}
  T2 = cluster{"Step": string, "Progress": f64, "Status": bool}
  T3 = cluster{"X": f64[], "Y": f64[], "Best Gaussian Fit": f64[], "Upper Bound": f64[], "Lower Bound": f64[]}
uses:
  NI::HTTP::GET.gvi
diagram:
  while {
    Wait(time to wait=100)
    for (N = 10) (iteration -> i1) {
      Increment(x=i1) -> w2
      Format Into String(formatString="Step %d", w2) -> w3
      Property Node(instance in=T2 {all zero or empty}, "Step"=w3, "Progress"=66, "Status"=TRUE) -> (instance out=w4)
      append w4 to w1
    }
    $"Data Grid" <- w1
    call "GET.gvi"(url="http://cirrostratus:8080/hal/parametric-curve") -> (body=w5)
    Unflatten From JSON(JSON string=w5, type and defaults=T3 {all zero or empty}) -> (value=w6)
    Property Node(instance in=w6) -> ("X"=w7, "Y"=w8, "Best Gaussian Fit"=w9, "Upper Bound"=w10, "Lower Bound"=w11)
    Build Index And Bundle Cluster Array(w7, w8) -> (out=w12)
    Build Index And Bundle Cluster Array(w7, w9) -> (out=w13)
    Build Index And Bundle Cluster Array(w7, w10) -> (out=w14)
    Build Index And Bundle Cluster Array(w7, w11) -> (out=w15)
    Build Array(w12, w13, w14, w15) -> w16
    $"Observed Data and Fitted Curve" <- w16
    stop if FALSE
  }
